# Dynamo graph Bunch Pipe Filter by excel.dyn (Dynamo 2.10.1.3976)
# packages: archi-lab.net 2022.212.3222, BumbleBee 2021.25.3, Data-Shapes 2025.3.118

code_block = CodeBlock { "Select Excel File"; }
filepath_data = Custom[FilePath Data](ButtonText=code_block)  # package Data-Shapes; Create filepath input for UI.MultipleInputForm ++ . Check out www.data-shapes.net for more infos !
code_block_2 = CodeBlock { "Select View"; }
categories = Categories("OST_Views")
all_elements_of_category = ElementsOfCategory(Category=categories)
name = Element.Name(element=all_elements_of_category)
dropdown_data = Custom[DropDown Data](InputName=code_block_2, Keys=name, Values=all_elements_of_category)  # package Data-Shapes; Create data for DropDown input in UI.MultiInputForm ++ . Check out www.data-shapes.net for more infos.
code_block_3 = CodeBlock { "Filter By?"; }
code_block_4 = CodeBlock { "Mark"; "Comments"; "System Type"; }
list_create = List.Create(item0=code_block_4.out0, item1=code_block_4.out1, item2=code_block_4.out2)
dropdown_data_2 = Custom[DropDown Data](InputName=code_block_3, Keys=list_create, Values=list_create)
list_create_2 = List.Create(item0=filepath_data, item1=dropdown_data, item2=dropdown_data_2)
code_block_5 = CodeBlock { 1; }
multipleinputform = Custom[MultipleInputForm ++](Inputs=list_create_2, Toggle=code_block_5)  # package Data-Shapes; Create a form with multiple inputs. see www.data-shapes.net for tutorials and infos!
code_block_6 = CodeBlock { 1; }
getItemAtIndex = List.GetItemAtIndex(list=multipleinputform.User_Inputs, index=code_block_6)
code_block_7 = CodeBlock { 0; }
getItemAtIndex_2 = List.GetItemAtIndex(list=multipleinputform.User_Inputs, index=code_block_7)
boolean = BoolSelector(true)
code_block_8 = CodeBlock { "Sheet1"; }
read_excel = Custom[Read Excel](filePath=getItemAtIndex_2, runIt=boolean, sheetName=code_block_8, byColumn=boolean)  # package BumbleBee; This node will read an excel file. You can read an entore sheet contents, read from specific origin cell, read only specific range, or do all of the former for multiple sheets at the same time.
code_block_9 = CodeBlock { 0; }
removeItemAtIndex = List.RemoveItemAtIndex(list=read_excel@L2, indices=code_block_9)
getItemAtIndex_3 = List.GetItemAtIndex(list=removeItemAtIndex, index=code_block_9)
categories_2 = Categories("OST_PipeFitting")
categories_3 = Categories("OST_PipeCurves")
list_create_3 = List.Create(item0=categories_2, item1=categories_3)
code_block_10 = CodeBlock { 2; }
getItemAtIndex_4 = List.GetItemAtIndex(list=multipleinputform.User_Inputs, index=code_block_10)
select_rule_type = FilterRuleTypesUi("equals")
code_block_11 = CodeBlock { 1; }
getItemAtIndex_5 = List.GetItemAtIndex(list=removeItemAtIndex, index=code_block_11)
code_block_12 = CodeBlock { 1; }
chop = List.Chop(list=getItemAtIndex_5, lengths=code_block_12)
createRule = archilab.Revit.Elements.FilterRule.CreateRule(categories=list_create_3, parameterName=getItemAtIndex_4, ruleType=select_rule_type, parameterValue=chop@L2)
createOrSet = archilab.Revit.Elements.FilterSet.CreateOrSet(filterRules=createRule)
createFilter = archilab.Revit.Elements.ViewFilter.CreateFilter(name=getItemAtIndex_3, category=list_create_3, filterSet=createOrSet)
addFilter = View.AddFilter(view=getItemAtIndex, parameterFilter=createFilter)
fill_patterns = FillPatterns("<Solid fill>")
boolean_2 = BoolSelector(false)
read_excel_2 = Custom[Read Excel](filePath=getItemAtIndex_2, runIt=boolean, sheetName=code_block_8, byColumn=boolean_2)
code_block_13 = CodeBlock { 0; }
removeItemAtIndex_2 = List.RemoveItemAtIndex(list=read_excel_2@L3, indices=code_block_13)
getItemAtIndex_6 = List.GetItemAtIndex(list=removeItemAtIndex_2, index=code_block_13)
code_block_14 = CodeBlock { 0..1; }
removeItemAtIndex_3 = List.RemoveItemAtIndex(list=getItemAtIndex_6@L2, indices=code_block_14)
transpose = List.Transpose(lists=removeItemAtIndex_3)

# group: R
code_block_15 = CodeBlock { 0; }
getItemAtIndex_7 = List.GetItemAtIndex(list=transpose, index=code_block_15)

# group: G
code_block_16 = CodeBlock { 1; }
getItemAtIndex_8 = List.GetItemAtIndex(list=transpose, index=code_block_16)

# group: B
code_block_17 = CodeBlock { 2; }
getItemAtIndex_9 = List.GetItemAtIndex(list=transpose, index=code_block_17)

byARGB = Color.ByARGB(r=getItemAtIndex_7, g=getItemAtIndex_8, b=getItemAtIndex_9)
create = archilab.Revit.Elements.OverrideGraphicsSettings.Create(projectionForegroundFillPattern=fill_patterns, projectionForegroundFillColor=byARGB, projectionBackgroundFillPattern=fill_patterns, projectionBackgroundFillColor=byARGB, lacing=Longest)
code_block_18 = CodeBlock { 0; 1; }
setFilterOverrides = archilab.Revit.Views.Views.SetFilterOverrides(views=getItemAtIndex, viewFilter=createFilter, overrides=create, show=code_block_18.out1, isEnabled=code_block_18.out1)
count = List.Count(list=getItemAtIndex_6)
