# Dynamo graph Create Sheets By Excel.dyn (Dynamo 2.19.3.6394)
# packages: Data-Shapes 2022.2.105, BumbleBee 2021.25.3, Clockwork for Dynamo 2.x 2.12.2, spring nodes 210.1.1

code_block = CodeBlock { "Browse Excel Sheet"; }
filepath_data = Custom[FilePath Data](ButtonText=code_block)  # package Data-Shapes; Create filepath input for UI.MultipleInputForm ++ . Check out www.data-shapes.net for more infos !
code_block_2 = CodeBlock { "Sheet Name"; }
code_block_3 = CodeBlock { "Sheet1"; }
textbox_data = Custom[TextBox Data](InputName=code_block_2, DefaultText=code_block_3)  # package Data-Shapes; Create Data for TextBox input in UI.MultipleInputForm ++ . Check out www.data-shapes.net for more informations
code_block_4 = CodeBlock { "Select Title Block"; }
categories = Categories("OST_TitleBlocks")
all_family_types_of_category = Custom[All Family Types Of Category](category=categories)  # package Clockwork for Dynamo 2.x; Gets all family types/symbols of a given category in the model.
name = Family.Name(family=all_family_types_of_category)
dropdown_data = Custom[DropDown Data](InputName=code_block_4, Keys=name, Values=all_family_types_of_category)  # package Data-Shapes; Create data for DropDown input in UI.MultiInputForm ++ . Check out www.data-shapes.net for more infos.
code_block_5 = CodeBlock { "Create Print-Set?"; }
code_block_6 = CodeBlock { "Yes"; }
boolean_input = Custom[Boolean input](InputName=code_block_5, SideText=code_block_6)  # package Data-Shapes; Creates a boolean input for UI.MultipleInputForm ++ . Check out www.data-shapes.net for more infos!
list_create = List.Create(item0=filepath_data, item1=textbox_data, item2=dropdown_data, item3=boolean_input)
code_block_7 = CodeBlock { "true"; }
number = DoubleInput(500)
number_2 = DoubleInput(250)
multipleinputform = Custom[MultipleInputForm ++](Inputs=list_create, Toggle=code_block_7, Width_optional=number, LabelWidth_optional=number_2)  # package Data-Shapes; Create a form with multiple inputs. see www.data-shapes.net for tutorials and infos!
code_block_8 = CodeBlock(x=multipleinputform.User_Inputs)
# ---------- code_block_8.designscript (4 lines) ----------
l1 = List.GetItemAtIndex(x, 0);
l2 = List.GetItemAtIndex(x, 1);
l3 = List.GetItemAtIndex(x, 2);
l4 = List.GetItemAtIndex(x, 3);
# ----------------------------------------
boolean = BoolSelector(true)
read_excel = Custom[Read Excel](filePath=code_block_8.l1, runIt=boolean, sheetName=code_block_8.l2)  # package BumbleBee; This node will read an excel file. You can read an entore sheet contents, read from specific origin cell, read only specific range, or do all of the former for multiple sheets at the same time.
code_block_9 = CodeBlock { 0; 1; }
getItemAtIndex = List.GetItemAtIndex(list=read_excel@L2, index=code_block_9.out1)
getItemAtIndex_2 = List.GetItemAtIndex(list=read_excel@L2, index=code_block_9.out0)
byNameNumberTitleBlock = Sheet.ByNameNumberTitleBlock(sheetName=getItemAtIndex, sheetNumber=getItemAtIndex_2, titleBlockFamilyType=code_block_8.l3, lacing=Longest)
formula = Formula("if(x=true,y,0)", x=code_block_8.l4, y=byNameNumberTitleBlock)
code_block_10 = CodeBlock { "Name Of Print-Set"; }
textbox_data_2 = Custom[TextBox Data](InputName=code_block_10)
code_block_11 = CodeBlock { "Overwrite Print-set?"; }
code_block_12 = CodeBlock { "Yes"; }
boolean_input_2 = Custom[Boolean input](InputName=code_block_11, SideText=code_block_12)
list_create_2 = List.Create(item0=textbox_data_2, item1=boolean_input_2)
code_block_13 = CodeBlock { true; }
contains = List.Contains(list=code_block_8.l4, item=code_block_13)
code_block_14 = CodeBlock { 500; 250; }
multipleinputform_2 = Custom[MultipleInputForm ++](Inputs=list_create_2, Toggle=contains, Width_optional=code_block_14.out0, LabelWidth_optional=code_block_14.out1)
code_block_15 = CodeBlock(x=multipleinputform_2.User_Inputs) { l1 = List.GetItemAtIndex(x, 0); l2 = List.GetItemAtIndex(x, 1); }
ꟿ_viewset_byviewsname = Custom[ꟿ ViewSet.ByViewsName](views=formula, setName=code_block_15.l1, Overwrite=code_block_15.l2)  # package spring nodes; Creates a set of views(or sheets) for printing. If the set exists, set Overwrite to true to replace it.
