# Dynamo graph Home_Backup.dyn (Dynamo 2.10.1.3976)
# packages: archi-lab.net 2022.212.3222, BumbleBee 2021.25.3

views = Views("0 - Mech")
file_path = Filename(".\Colour Excel.xlsx")
file_from_path = FileObject(path=file_path)
boolean = BoolSelector(true)
code_block = CodeBlock { "Sheet1"; }
read_excel = Custom[Read Excel](filePath=file_from_path, runIt=boolean, sheetName=code_block, byColumn=boolean)  # package BumbleBee; This node will read an excel file. You can read an entore sheet contents, read from specific origin cell, read only specific range, or do all of the former for multiple sheets at the same time.
code_block_2 = CodeBlock { 1; }
getItemAtIndex = List.GetItemAtIndex(list=read_excel, index=code_block_2)
categories = Categories("OST_PipeCurves")
code_block_3 = CodeBlock { "Comments"; }
select_rule_type = FilterRuleTypesUi("equals")
code_block_4 = CodeBlock { 0; }
getItemAtIndex_2 = List.GetItemAtIndex(list=read_excel, index=code_block_4)
code_block_5 = CodeBlock { 1; }
chop = List.Chop(list=getItemAtIndex_2, lengths=code_block_5)
createRule = archilab.Revit.Elements.FilterRule.CreateRule(categories=categories, parameterName=code_block_3, ruleType=select_rule_type, parameterValue=chop@L2)
createOrSet = archilab.Revit.Elements.FilterSet.CreateOrSet(filterRules=createRule)
createFilter = archilab.Revit.Elements.ViewFilter.CreateFilter(name=getItemAtIndex, category=categories, filterSet=createOrSet)
addFilter = View.AddFilter(view=views, parameterFilter=createFilter)
boolean_2 = BoolSelector(false)
view_type = ViewTypesUi("FloorPlan")
getByType = archilab.Revit.Views.Views.GetByType(viewType=view_type)
code_block_6 = CodeBlock { 0; 1; }
getItemAtIndex_3 = List.GetItemAtIndex(list=getByType, index=code_block_6.out0)
fill_patterns = FillPatterns("<Solid fill>")
byARGB = Color.ByARGB()
create = archilab.Revit.Elements.OverrideGraphicsSettings.Create(projectionForegroundFillPattern=fill_patterns, projectionForegroundFillColor=byARGB, projectionBackgroundFillPattern=fill_patterns, projectionBackgroundFillColor=byARGB, lacing=Longest)
setFilterOverrides = archilab.Revit.Views.Views.SetFilterOverrides(views=getItemAtIndex_3, viewFilter=createFilter, overrides=create, show=code_block_6.out1, isEnabled=code_block_6.out1)  # frozen
views_2 = Views("0 - Mech")
contains = List.Contains()  # unwired: list, item
contains_2 = String.Contains()  # unwired: str, searchFor
boolean_3 = BoolSelector(false)
read_excel_2 = Custom[Read Excel](filePath=file_from_path, runIt=boolean, sheetName=code_block, byColumn=boolean_3)
code_block_7 = CodeBlock { 2; 1; }
code_block_8 = CodeBlock { 0; }
getItemAtIndex_4 = List.GetItemAtIndex(list=read_excel_2, index=code_block_8)
count = List.Count(list=getItemAtIndex_4)
slice = List.Slice(list=read_excel_2@L2, start=code_block_7.out0, end=count)
count_2 = List.Count(list=slice)
code_block_9 = CodeBlock { 1; }
sub = count_2 - code_block_9
range = Range(end=sub, step=code_block_9)
code_block_10 = CodeBlock { 0; }
slice_2 = List.Slice(list=range, start=code_block_10, end=count_2, step=code_block_9)
getItemAtIndex_5 = List.GetItemAtIndex(list=slice, index=slice_2)
code_block_11 = CodeBlock { 1; }
