# Dynamo graph Model in place to RFA.dyn (Dynamo 3.6.0.9395)
# packages: Data-Shapes 2026.4.2

file_path = Filename("C:\ProgramData\Autodesk\RVT 2024\Family Templates\English-Imperial\Generic Model.rft")
code_block = CodeBlock { "Select Revit Template Path"; }
string = StringInput("C:\ProgramData\Autodesk\RVT 2026\Family Templates\English-Imperial\Generic Model.rft")
filepath_data = Custom[FilePath Data](InputName=code_block, DefaulPath=string, ButtonText=string)  # package Data-Shapes; Create filepath input for UI.MultipleInputForm ++ . Check out www.data-shapes.net for more infos !
code_block_2 = CodeBlock { "Select Model Elements"; }
selectmodelelements_data = Custom[SelectModelElements Data](ButtonText=code_block_2)  # package Data-Shapes; Creates a Revit element selection input for UI.MultipleInputForm++ . Check out www.data-shapes.net for more infos!
code_block_3 = CodeBlock { "Family Name"; }
textbox_data = Custom[TextBox Data](InputName=code_block_3)  # package Data-Shapes; Create Data for TextBox input in UI.MultipleInputForm ++ . Check out www.data-shapes.net for more informations
code_block_4 = CodeBlock { "Select Category"; }
categories_list = Custom[Categories list]()  # package Data-Shapes; Gives list of all Revit categories and a matching list of their names
byName = Category.ByName(name=categories_list.Category_name_s)
dropdown_data = Custom[DropDown Data](InputName=code_block_4, Keys=categories_list.Category_name_s, Values=byName)  # package Data-Shapes; Create data for DropDown input in UI.MultiInputForm ++ . Check out www.data-shapes.net for more infos.
list_create = List.Create(item0=filepath_data, item1=selectmodelelements_data, item2=textbox_data, item3=dropdown_data)
code_block_5 = CodeBlock { 1; }
multipleinputform = Custom[MultipleInputForm ++](Inputs=list_create, Toggle=code_block_5)  # package Data-Shapes; Create a form with multiple inputs. see www.data-shapes.net for tutorials and infos!
code_block_6 = CodeBlock { 1; }
getItemAtIndex = List.GetItemAtIndex(list=multipleinputform.User_Inputs, index=code_block_6)
geometry = Element.Geometry(element=getItemAtIndex)
byUnion = Solid.ByUnion(solids=geometry)
code_block_7 = CodeBlock { 2; }
getItemAtIndex_2 = List.GetItemAtIndex(list=multipleinputform.User_Inputs, index=code_block_7)
code_block_8 = CodeBlock { 3; }
getItemAtIndex_3 = List.GetItemAtIndex(list=multipleinputform.User_Inputs, index=code_block_8)
code_block_9 = CodeBlock { 0; }
getItemAtIndex_4 = List.GetItemAtIndex(list=multipleinputform.User_Inputs, index=code_block_9)
string_2 = StringInput("Default")
byName_2 = Material.ByName(name=string_2)
byGeometry = FamilyType.ByGeometry(solidGeometry=byUnion, name=getItemAtIndex_2, category=getItemAtIndex_3, templatePath=getItemAtIndex_4, material=byName_2)
byGeometry_2 = BoundingBox.ByGeometry(geom=geometry)
minPoint = BoundingBox.MinPoint(boundingBox=byGeometry_2)
byPoint = FamilyInstance.ByPoint(familyType=byGeometry, point=minPoint)
