# Dynamo graph Overlapped Tags Vs Category.dyn "Highlight Insersecting Tags" (Dynamo 2.19.3.6394)
# packages: Clockwork for Dynamo 2.x 2.12.2, Data-Shapes 2022.2.105, spring nodes 210.1.1, archi-lab.net 2024.217.1024, Genius Loci 2024.2.26

activeViewFromCurrentDocument = Custom[Document.ActiveViewFromCurrentDocument]()  # package Clockwork for Dynamo 2.x; Gets the active view of the current document
all_elements_in_view_s = Custom[All Elements In View(s)](Views=activeViewFromCurrentDocument)  # package Data-Shapes; Retrieves all visible element in a view or a set of views
string_from_object = FromObject(object=all_elements_in_view_s)
flatten = List.Flatten(list=string_from_object)
code_block = CodeBlock { "Tag"; }
contains = String.Contains(string=flatten, searchFor=code_block)
filterByBoolMask = List.FilterByBoolMask(list=flatten@L2, mask=contains)
ꟿ_document_activeview = Custom[ꟿ Document.ActiveView]()  # package spring nodes; Selects the current document's active view. Supports more view types than the built-in option. Will be depreciated once the bult in node works with all plan types.
resetElementOverrides = Custom[View.ResetElementOverrides](element=filterByBoolMask.in, view=ꟿ_document_activeview)  # package Clockwork for Dynamo 2.x; Resets all overrides for an element in a given view
code_block_2 = CodeBlock { "Select Tag"; }
getCategory = Element.GetCategory(element=all_elements_in_view_s)
flatten_2 = List.Flatten(list=getCategory)
isNull = Object.IsNull(object=flatten_2)
filterByBoolMask_2 = List.FilterByBoolMask(list=flatten_2, mask=isNull)
string_from_object_2 = FromObject(object=filterByBoolMask_2.out)
flatten_3 = List.Flatten(list=string_from_object_2)
uniqueItems = List.UniqueItems(list=flatten_3)
code_block_3 = CodeBlock { "Tag"; }
contains_2 = String.Contains(string=uniqueItems, searchFor=code_block_3)
filterByBoolMask_3 = List.FilterByBoolMask(list=uniqueItems, mask=contains_2)
dropdown_data = Custom[DropDown Data](InputName=code_block_2, Keys=filterByBoolMask_3.in, Values=filterByBoolMask_3.in)  # package Data-Shapes; Create data for DropDown input in UI.MultiInputForm ++ . Check out www.data-shapes.net for more infos.
code_block_4 = CodeBlock { "V/s Category"; }
dropdown_data_2 = Custom[DropDown Data](InputName=code_block_4, Keys=filterByBoolMask_3.out, Values=filterByBoolMask_3.out)
list_create = List.Create(item0=dropdown_data, item1=dropdown_data_2)

# group: Input
reset_dropdown = BoolSelector(true)  # graph input
tag_boundry_w_l = StringInput("1000*645")  # graph input
override_color_r_g_b = StringInput("255,0,0")  # graph input

multipleinputform = Custom[MultipleInputForm ++](Inputs=list_create, Toggle=reset_dropdown)  # package Data-Shapes; Create a form with multiple inputs. see www.data-shapes.net for tutorials and infos!
code_block_5 = CodeBlock { 0; }
getItemAtIndex = List.GetItemAtIndex(list=multipleinputform.User_Inputs, index=code_block_5)
byName = Category.ByName(name=getItemAtIndex)
all_elements_of_category = ElementsOfCategory(Category=byName)
code_block_6 = CodeBlock { 1; }
getItemAtIndex_2 = List.GetItemAtIndex(list=multipleinputform.User_Inputs, index=code_block_6)
byName_2 = Category.ByName(name=getItemAtIndex_2)
all_elements_of_category_2 = ElementsOfCategory(Category=byName_2)
boundingBox = Element.BoundingBox(element=all_elements_of_category_2)
maxPoint = BoundingBox.MaxPoint(boundingBox=boundingBox)
X = Point.X(point=maxPoint)
Y = Point.Y(point=maxPoint)
code_block_7 = CodeBlock { 0; }
byCoordinates = Point.ByCoordinates(x=X, y=Y, z=code_block_7)
minPoint = BoundingBox.MinPoint(boundingBox=boundingBox)
X_2 = Point.X(point=minPoint)
Y_2 = Point.Y(point=minPoint)
byCoordinates_2 = Point.ByCoordinates(x=X_2, y=Y_2, z=code_block_7)
byCorners = BoundingBox.ByCorners(min=byCoordinates, max=byCoordinates_2)
end = Revit.Transaction.Transaction.End(input=all_elements_of_category)
ꟿ_document_activeview_2 = Custom[ꟿ Document.ActiveView]()
resetElementOverrides_2 = Custom[View.ResetElementOverrides](element=end, view=ꟿ_document_activeview_2)
tagHeadPosition = archilab.Revit.Elements.Tags.TagHeadPosition(tag=resetElementOverrides_2.element)
byOrigin = CoordinateSystem.ByOrigin(origin=tagHeadPosition)
extract_numbers_from_string = Custom[Extract Numbers from String](strings=tag_boundry_w_l)  # package Genius Loci; Extracts a number or a list of numbers from a string and converts it to double.
code_block_8 = CodeBlock(t1=extract_numbers_from_string) { I0 = List.GetItemAtIndex(t1, 0); I1 = List.GetItemAtIndex(t1, 1); }
byWidthLength = Rectangle.ByWidthLength(plane=byOrigin, width=code_block_8.I0, length=code_block_8.I1)
patch = Curve.Patch(curve=byWidthLength)
orientedBoundingBox = Geometry.OrientedBoundingBox(geometry=patch)
maxPoint_2 = BoundingBox.MaxPoint(boundingBox=orientedBoundingBox)
X_3 = Point.X(point=maxPoint_2)
Y_3 = Point.Y(point=maxPoint_2)
code_block_9 = CodeBlock { 0; }
byCoordinates_3 = Point.ByCoordinates(x=X_3, y=Y_3, z=code_block_9)
minPoint_2 = BoundingBox.MinPoint(boundingBox=orientedBoundingBox)
X_4 = Point.X(point=minPoint_2)
Y_4 = Point.Y(point=minPoint_2)
byCoordinates_4 = Point.ByCoordinates(x=X_4, y=Y_4, z=code_block_9)
byCorners_2 = BoundingBox.ByCorners(min=byCoordinates_3, max=byCoordinates_4)
intersects = BoundingBox.Intersects(boundingBox=byCorners@L1, other=byCorners_2)
transpose = List.Transpose(lists=intersects)
formula = Formula("if(x=true,1,0)", x=transpose)
sum = Math.Sum(values=formula)
formula_2 = Formula("if(x>0,true,false)", x=sum)
filterByBoolMask_4 = List.FilterByBoolMask(list=all_elements_of_category, mask=formula_2)
extract_numbers_from_string_2 = Custom[Extract Numbers from String](strings=override_color_r_g_b)
code_block_10 = CodeBlock(t1=extract_numbers_from_string_2) { I0 = List.GetItemAtIndex(t1, 0); I1 = List.GetItemAtIndex(t1, 1); I2 = List.GetItemAtIndex(t1, 2); }
byARGB = Color.ByARGB(red=code_block_10.I0, green=code_block_10.I1, blue=code_block_10.I2)
overrideColorInView = Element.OverrideColorInView(element=filterByBoolMask_4.in, color=byARGB)
