# Dynamo graph Room Occupancy by KT.dyn (Dynamo 2.10.1.3976)
# packages: Data-Shapes 2022.2.105, Genius Loci 2022.1.5, Data-Shapes 2025.3.118

# group: Room Input
code_block = CodeBlock { "Select Room Name"; }
categories = Categories("OST_Rooms")
all_elements_of_category = ElementsOfCategory(Category=categories)
name = Room.Name(room=all_elements_of_category)
code_block_2 = CodeBlock { 1; }
listview_data = Custom[Listview Data](InputName=code_block, Keys=name, Values=name, ShowElementCount_optionnal=code_block_2)  # package Data-Shapes; Create data for ListView input in UI.MultiInputForm ++ . Check out www.data-shapes.net for more infos.
code_block_3 = CodeBlock { 1; }
multipleinputform = Custom[MultipleInputForm ++](Inputs=listview_data, Toggle=code_block_3)  # package Data-Shapes; Create a form with multiple inputs. see www.data-shapes.net for tutorials and infos!

code_block_4 = CodeBlock { 0; }
getItemAtIndex = List.GetItemAtIndex(list=multipleinputform.User_Inputs, index=code_block_4)
room_byname = Custom[Room ByName](NameOrNumber=getItemAtIndex)  # package Genius Loci; Enter the room/space name or number to get the room.

# group: Accessible Area Input
area = Room.Area(room=room_byname.Rooms)
accessible_are_in = DoubleInput(70)  # graph input
mul = area * accessible_are_in
code_block_5 = CodeBlock { 100; }
div = mul / code_block_5

# group: Occupancy Factor Input
occupancy_factor_m2_person = DoubleInput(10)  # graph input
div_2 = div / occupancy_factor_m2_person

# group: Roundup The Value
code_block_6 = CodeBlock { 0.495; }
add = div_2 + code_block_6
code_block_7 = CodeBlock { 0; }
number_to_rounded_string = Custom[Number to Rounded String](Number=add, Decimals=code_block_7)  # package Data-Shapes; Returns rounded number to specified number of decimals as string

# group: Output
code_block_8 = CodeBlock { "Occupancy"; }
setParameterByName = Element.SetParameterByName(element=room_byname.Rooms, parameterName=code_block_8, value=number_to_rounded_string)
